# Grasshopper definition ThickenMesh_Carla.gh (Grasshopper 1.0.7)
# plug-ins: Weaverbird, LunchBox

# Offset Distance
panel = Panel("-2")
mesh = Mesh(<mesh referenced from the Rhino model>)
# Weaverbird Thicken
# Used to create a thickened mesh
wbthicken = WeaverbirdsMeshThicken(MeshCurves=mesh, Distance=panel, OffsetType=0)
# Weaverbird Loop Subdivision
# Used to smoothen mesh.
# Catmull Clarke and Mesh Smooth work too.
panel_2 = Panel("Thickened Mesh")
wbloop = WeaverbirdsLoopSubdivision(MeshCurves=wbthicken, Level=1, SmoothNakedEdges=1)
bake = ObjectBake(
    BakeToggle=False,
    GeometryObjects=wbloop,
    Layer="GH_Bake",
    ObjectName=panel_2,
    ObjectColor=ColourSwatch(SwatchColor=RGB(255, 255, 255)),
    LayerColor=RGB(255, 255, 255))
